# Grasshopper definition QinghongShaoLA2.gh (Grasshopper 1.0.8)
# plug-ins: RhinoCodePluginGH

data3 = Slider(4, range=-10..20)
data2 = Slider(3, range=-10..20)
data2_2 = Slider(12, range=0..100)
data1 = Slider(9, range=0..30)
data3_2 = Slider(19, range=0..100)
# Large Assignment 2: Parametric Vessels
# Name:  Qinghong Shao
# E-mail:  qinghongshao@unm.edu
# Course:   CS591, Computational Fabrication
# Submitted:    9/23/2024
# 
# This project includes two optional printing contour functions, users can adjust the printing thickness, smoothness (parameter n), contour radius (parameter radius), contour amplitude (parameter amp), and optional twist operation.
data1_2 = Slider(1, range=-10..29)
data1_3 = Slider(63, range=0..100)
data2_3 = Slider(25, range=0..200)
data3_3 = Slider(26, range=0..200)
data1_4 = Slider(40, range=0..59)
data3_4 = Slider(8, range=0..100)
data2_4 = Slider(14, range=0..50)
data1_5 = Slider(5, range=0..10)
data2_5 = Slider(3, range=0..10)
data3_5 = Slider(4, range=0..10)
value_list = ValueList({"FlowerCircle": 0, "Polygon": 1}, selected="FlowerCircle")
merge = Merge(Data1=data1_3, Data2=data2_3, Data3=data3_3)
amp = Merge(Data1=data1_2, Data2=data2, Data3=data3)
merge_2 = Merge(Data1=data1_4, Data2=data2_4, Data3=data3_4)
merge_3 = Merge(Data1=data1, Data2=data2_2, Data3=data3_2)
merge_4 = Merge(Data1=data1_5, Data2=data2_5, Data3=data3_5)
python_3_script = Python3Script(contour=value_list, amp=amp, radius=merge_3, n=merge, z=merge_2, k=merge_4)  # -> out, a; inputs radius: Double, n: Int32, z: Double, k: Double
# ---------- python_3_script: Python ----------
import rhinoscriptsyntax as rs
import math

def polarToXY(r, theta, z):
    x = r * math.cos(math.radians(theta))
    y = r * math.sin(math.radians(theta))
    point = rs.CreatePoint(x,y,z)
    return point

def circle(radius, z):
    points = []
    for i in range (0,361):
        r = radius
        point = polarToXY(r, i, z)
        points.append(point)
    return points

def polygon(radius, n, z):
    print("radius:"+ str(radius))
    print("n:"+ str(z))
    print("z:"+ str(z))
    points = []
    for i in range (0, n+1):
        r = radius
        theta = 360/n*i
        point = polarToXY(r, theta, z)
        points.append(point)
    return points

def FlowerCircle(radius, amp, k, n, z ):
    points = []
    
    for i in range(0, n+1):
        theta = 360 / n * i 
        r = radius + amp * math.sin(math.radians(k * theta)) 
        point = polarToXY(r, theta, z)  
        points.append(point)
    
    return points

if contour == 0:
    points = FlowerCircle(radius,amp,k,n,z)
else:
    points =  polygon(radius, n, z)

# points = FlowerCircle(radius,amp,k,n,z)
line = rs.AddPolyline(points)
curve = rs.AddCurve(points)
curve2 = rs.AddInterpCurve(points)

a = line




'''
# 极坐标转换为笛卡尔坐标函数
def polarToXY(r, theta, z):
    x = r * math.cos(math.radians(theta))
    y = r * math.sin(math.radians(theta))
    return [x, y, z]

# 生成花瓣曲线的函数
def roseCurve(radius, k, n, z):
    points = []
    
    # 生成花瓣曲线
    for i in range(n+1):
        theta = 360 / n * i  # 角度均匀分布
        r = radius * math.sin(math.radians(k * theta))  # 玫瑰曲线方程
        point = polarToXY(r, theta, z)  # 计算笛卡尔坐标
        points.append(point)
    
    return points

radius = [5,6,7]  # 花瓣的大小
k = [6,4,3]       # 花瓣的数量
n = [100,100,100]     # 曲线的分段数，决定曲线平滑度
z = [0,10,20]
'''





'''

def catFaceOutline(radius, n, z):
    points = []
    
    # contour of cat face
    for i in range(0, n+1):
        theta = 360 / n * i
        r = radius
        point = polarToXY(r, theta, z)
        points.append(point)
    
    # 
    ear_base_factor = cat_ear_base  # 控制耳朵底部的宽度，值越小越宽
    ear_height_factor = cat_ear_height  # 控制耳朵的高度，值越大耳朵越高

    # left ear
    left_ear_base1 = polarToXY(radius * ear_base_factor, 60, z)  # 调整基点的角度让耳朵更宽
    left_ear_tip = polarToXY(radius * ear_height_factor, 75, z)
    left_ear_base2 = polarToXY(radius * ear_base_factor, 90, z)  # 对应增加另一侧基点角度
    
    points.extend([left_ear_base1, left_ear_tip, left_ear_base2])
    
    # right ear
    right_ear_base1 = polarToXY(radius * ear_base_factor, 125, z)
    right_ear_tip = polarToXY(radius * ear_height_factor, 135, z)
    right_ear_base2 = polarToXY(radius * ear_base_factor, 145, z)
    points.extend([right_ear_base1, right_ear_tip, right_ear_base2])

    #return point of list
    return points

'''
# ---------- end python_3_script ----------
twist_angle = Merge(Data1=Slider(33, range=-100..100), Data2=Slider(-12, range=-100..100), Data3=Slider(29, range=-100..100))
python_3_script_2 = Python3Script(curves=python_3_script.a, twist_angle=twist_angle)  # -> out, a; inputs curves: list of Curve, twist_angle: list of Int32
# ---------- python_3_script_2: Python ----------
import rhinoscriptsyntax as rs
import Rhino.Geometry as geom
import math

def twist(curve, angle):
    twist = geom.Transform.RotationZYX(math.radians(angle), 0, 0)
    curve.Transform(twist)

for i in range (len(curves)):
    twist(curves[i], twist_angle[i])

a = curves
# ---------- end python_3_script_2 ----------
python_3_script_3 = Python3Script(curves=python_3_script.a, thickness=Slider(1.583, range=0..6))  # -> out, vase_shell, bottom; inputs curves: list of Curve, thickness: Double
# ---------- python_3_script_3: Python ----------
import rhinoscriptsyntax as rs
import math

import rhinoscriptsyntax as rs
import math

vase_outer = rs.AddLoftSrf(curves)
rs.JoinSurfaces(vase_outer)
rs.CapPlanarHoles(vase_outer)


offset_curves = []
point = rs.CreatePoint(0,0,0)
for i in range (0, len(curves)):
    print("thickness" + str(thickness) + "And curve" + str(curves[i]))
    offset_curve = rs.OffsetCurve(curves[i], point, thickness)
    offset_curves.append(offset_curve[0])

vase_inner = rs.AddLoftSrf(offset_curves)
rs.CapPlanarHoles(vase_inner)


vase_shell = rs.BooleanDifference(vase_outer, vase_inner)

bottom_curve = curves[len(curves)-1]
a = bottom_curve
bottom_surface = rs.AddPlanarSrf([bottom_curve])
curve = rs.AddLine(rs.CreatePoint(0,0,0), rs.CreatePoint(0,0,-thickness))
bottom = rs.ExtrudeSurface(bottom_surface, curve)
a = bottom














'''
vase_outer = rs.AddLoftSrf(curves)
rs.JoinSurfaces(vase_outer)
rs.CapPlanarHoles(vase_outer)

print("this is the curves0:" + str(curves[0]))
print("this is the curves1:" + str(curves[1]))
print("this is the curves2:" + str(curves[2]))

def convert_to_guid(curve):
    return rs.coercecurve(curve)


offset_curves = []
point = rs.CreatePoint(0,0,0)
for i in range (0, len(curves)):
    #curves[i] = convert_to_guid(curves[i])
    offset_curve = rs.OffsetCurve(curves[i], point, thickness)
    if offset_curve:
        offset_curves.append(offset_curve[0])  
    else:
        print("this is type of offset_curve:"+ str(offset_curve))

vase_inner = rs.AddLoftSrf(offset_curves)
rs.CapPlanarHoles(vase_inner)

vase_shell = rs.BooleanDifference(vase_outer, vase_inner)

bottom_curve = curves[len(curves)-1]
a = bottom_curve
bottom_surface = rs.AddPlanarSrf([bottom_curve])
curve = rs.AddLine(rs.CreatePoint(0,0,0), rs.CreatePoint(0,0,-thickness))
bottom = rs.ExtrudeSurface(bottom_surface, curve)
a = bottom
'''
# ---------- end python_3_script_3 ----------
merge_5 = Merge(Data1=python_3_script_3.vase_shell, Data2=python_3_script_3.bottom)
solid_union = SolidUnion(Breps=flatten(merge_5))
panel = Panel(solid_union)
